# Grasshopper definition CLT BF Calc.gh (Grasshopper 1.0.8)
# plug-ins: ShapeDiverForGrasshopper

# ---- group: fibre_parameters
stock_material_length_ft = Slider(12, range=10..20)
stock_material_size = ValueList({"2 x 4": "{0;0}", "2 x 6": "{0;1}", "2 x 8": "{0;2}", "2 x 10": "{0;3}"}, selected="2 x 8")
overage_oaw = BooleanToggle(True)
planing_removal_width_mm = DirectTextInput(maxlength=10000, text="5")
path = DataPath(stock_material_size)
int = Integer(stock_material_length_ft)
num = Number(planing_removal_width_mm)
bool = Boolean(overage_oaw)

# ---- group: Waste & Overages
finger_jointer_waste = Slider(3, range=1..5)
ordering_overage = Slider(0, range=0..25)
int_2 = Integer(finger_jointer_waste)
int_3 = Integer(ordering_overage)

# ---- group: billet_parameters (in)
billet_layers = Slider(3, range=3..9)
overage_for_oal = BooleanToggle(False)
# Inputs
billet_width_in = DirectTextInput(maxlength=10000, text="96")
billet_lenght_in = DirectTextInput(maxlength=10000, text="144")
billet_height_mm = DirectTextInput(maxlength=10000, text="105")
billet_overagexy_in = DirectTextInput(maxlength=10000, text="1")
num_2 = Number(billet_width_in)
num_3 = Number(billet_lenght_in)
num_4 = Number(billet_height_mm)
num_5 = Number(billet_overagexy_in)
bool_2 = Boolean(overage_for_oal)
int_4 = Integer(billet_layers)

# ----
sddp = ShapeDiverDocumentPayload({AbsoluteTolerance=0, AngleTolerance=0, DistanceDisplayPrecision=0, GltfVersion="Gltf2", GrasshopperVersion="1.0.0008", InputGroups="{}", OutputGroups="{}", RelativeTolerance=0, RhinoVersion="8.10.24228.13001", UnitSystem=0, VersionCreated="1.18.1.0", VersionSaved="1.19.0.0"})

# ---- group: Pricing
market_price_m3 = DirectTextInput(maxlength=10000, text="1350")
production_price_m3 = DirectTextInput(maxlength=10000, text="1100")
num_6 = Number(market_price_m3)
num_7 = Number(production_price_m3)

# ---- group: billet_height (mm)
# Trimmed Billet Calcs, Geo, & Display
num_8 = Number(num_4)

# ---- group: billet_width (in)
# Raw Billet Calcs, Geo, & Display
num_9 = Number(num_2)

# ---- group: billet_overageOAL
bool_3 = Boolean(bool_2)

# ---- group: billet_overageXY (in)
num_10 = Number(num_5)

# ---- group: billet_length (in)
num_11 = Number(num_3)

# ---- group: overage_order
# Lamella Thickness
int_5 = Integer(int_3)

# ---- group: billet_layers
int_6 = Integer(int_4)

# ---- group: stock_parameters
# Stock Profiles
_2x4 = Panel("""1.5
3.5
2
4""")
_2x6 = Panel("""1.5
5.5
2
6""")
_2x8 = Panel("""1.5
7.25
2
8""")
_2x8_2 = Panel("""1.5
9.25
2
10""")

# ---- group: fibre_stockLength (ft)
int_7 = Integer(int)

# ---- group: waste_FJ
int_8 = Integer(int_2)

# ---- group: billet_layers
# Lamella Error Check
int_9 = Integer(int_4)

# ---- group: fibre_stockProfile
# Stock Sizes MM
path_2 = DataPath(stock_material_size)

# ---- group: billet_height (mm)
num_12 = Number(num_4)

# ---- group: billet_layers
# Dimension Display - Lines
int_10 = Integer(int_4)

# ---- group: fibre_planningOAW
bool_4 = Boolean(bool)

# ---- group: billet_width (in)
num_13 = Number(num_2)

# ---- group: billet_length (in)
num_14 = Number(num_3)

# ---- group: billet_height (mm)
num_15 = Number(num_4)

# ---- group: fibre_planningRemoval
num_16 = Number(num)

# ---- group: pricing_marketRate ($/m3)
# Pricing Calculations
num_17 = Number(market_price_m3)

# ---- group: pricing_productionCost ($/m3)
num_18 = Number(production_price_m3)

# ---- group: billet_height (mm)
num_19 = Number(num_4)

# ---- group: rawBillet_calcs
eval = Evaluate(F="If(x = False,2,1)*y", x=bool_3, y=num_10)
addition = Addition(A=num_9, B=eval)
addition_2 = Addition(A=num_11, B=eval)

# ---- group: rawBillet_width (in)
num_20 = Number(addition)

# ---- group: rawBillet_length (in)
num_21 = Number(addition_2)

# ---- group: trimmedBillet_in>mm
c_units = ConvertUnits(Data=num_13, Source=8, Target=2)
c_units_2 = ConvertUnits(Data=num_14, Source=8, Target=2)

# ---- group: lamella_calcs
division = Division(A=num_12, B=int_9)

# ---- group: dimension_textImperial
c_units_3 = ConvertUnits(Data=num_19, Source=2, Target=8)
combine = CombineData(Input0=[num_20, num_21, c_units_3])  # -> Result, Index
num_22 = Number(combine.Result)
eval_2 = Evaluate(F="Format(\"{0:0.000}\", x)", x=num_22)
concat = Concatenate(FragmentC="[", FragmentD=eval_2, FragmentE=" in.]")
flip = FlipMatrix(Data=concat)

# ---- group: volume_lamellaCounts
division_2 = Division(A=int_6, B=2)
round = Round(Number=division_2)  # -> Nearest, Floor, Ceiling
subtraction = Subtraction(A=int_6, B=round.Ceiling)

# ---- group: stock_sort
entwine = Entwine(Branch00=_2x4, Branch01=_2x6, Branch02=_2x8, Branch03=_2x8_2, FlattenInputs=True)
branch = TreeBranch(Tree=entwine, Path=path_2, MaintainPaths=True)  # -> graft(Branch)
num_23 = Number(branch)
bang = ExplodeTree(Data=num_23)  # -> Branch0, Branch1, Branch2, Branch3

# ---- group: lamella_thickness
num_24 = Number(division)

num_25 = Number(num_24)

num_26 = Number(num_24)

# ---- group: trimmedBillet_geo
box = CenterBox(Base=PlaneXY(0, 0, 0), X=expr("x/2", c_units), Y=expr("x/2", c_units_2), Z=expr("x/2", num_15))

# ---- group: rawBillet_width (in)
num_27 = Number(addition)

# ---- group: rawBillet_length (in)
num_28 = Number(addition_2)

# ---- group: trimmedBillet_displayCurves
division_3 = Division(A=1, B=int_10)
series = Series(Start=division_3, Step=division_3, Count=expr("x-1", int_10))
debrep = DeconstructBrep(Brep=box)  # -> Faces, Edges, Vertices
expression = Expression(x=series, Expression="Format(\"0, {0}, 0\", x)")
item = ListItem(List=debrep.Faces, Index=[0, 1, 2, 3], Wrap=True)
iso = IsoCurve(Surface=reparameterize(graft(item)), UVPoint=expression)  # -> UIsocurve, VIsocurve

# ---- group: rawBillet_in>mm
c_units_4 = ConvertUnits(Data=num_27, Source=8, Target=2)
c_units_5 = ConvertUnits(Data=num_28, Source=8, Target=2)

# ---- group: rawBillet_length (mm)
num_29 = Number(c_units_5)

# ---- group: rawBillet_width (mm)
# Volume Calculations
num_30 = Number(c_units_4)

num_31 = Number(c_units_4)

# ---- group: rawBillet_length (mm)
num_32 = Number(c_units_5)

# ---- group: volume_longitudinalCount
int_11 = Integer(round.Ceiling)

# ---- group: volume_transverseCount
int_12 = Integer(subtraction)

# ---- group: stock_trueHeight (in)
num_33 = Number(bang.Branch0)

num_34 = Number(num_33)

# ---- group: stock_trueWidth (in)
num_35 = Number(bang.Branch1)

num_36 = Number(num_35)

# ---- group: stock_convertIN>MM
c_units_6 = ConvertUnits(Data=num_34, Source=8, Target=2)
c_units_7 = ConvertUnits(Data=num_36, Source=8, Target=2)

# ---- group: stock_trueWidth(mm)
num_37 = Number(c_units_7)

num_38 = Number(num_37)

# ---- group: efficiency_calcWidth
eval_3 = Evaluate(F="If(x = False,2,1)*y", x=bool_4, y=num_16)
subtraction_2 = Subtraction(A=num_38, B=eval_3)

# ---- group: stock_trueHeight(mm)
num_39 = Number(c_units_6)

num_40 = Number(num_39)

# Profile Efficiency
num_41 = Number(num_39)

# ---- group: lamella_check
expression_2 = Expression(x=num_25, y=num_40, Expression="If(x>y,TRUE,FALSE)")

# ---- group: stock_plannedWidth (mm)
num_42 = Number(subtraction_2)

num_43 = Number(num_42)

# ---- group: lamella_error
bool_5 = Boolean(expression_2)

# ---- group: efficiency_calc
multiplication = Multiplication(A=num_41, B=num_38)
multiplication_2 = Multiplication(A=num_26, B=num_42)
division_4 = Division(A=multiplication_2, B=multiplication)
multiplication_3 = Multiplication(A=division_4, B=100)

# ---- group: volume_transLength
division_5 = Division(A=num_29, B=num_43)
round_2 = Round(Number=division_5)  # -> Nearest, Floor, Ceiling
multiplication_4 = Multiplication(A=round_2.Ceiling, B=num_30)
multiplication_5 = Multiplication(A=multiplication_4, B=int_12)

# ---- group: stock_nomHeight (in)
num_44 = Number(bang.Branch2)

num_45 = Number(num_44)

# ---- group: stock_nomWidth (in)
num_46 = Number(bang.Branch3)

num_47 = Number(num_46)

# ---- group: volume_longLength
division_6 = Division(A=num_30, B=num_43)
round_3 = Round(Number=division_6)  # -> Nearest, Floor, Ceiling
multiplication_6 = Multiplication(A=round_3.Ceiling, B=num_29)
multiplication_7 = Multiplication(A=multiplication_6, B=int_11)

# ---- group: efficiency_value
num_48 = Number(multiplication_3)

# ---- group: rawBillet_geo
box_2 = CenterBox(Base=PlaneXY(0, 0, 0), X=expr("x/2", num_31), Y=expr("x/2", num_32), Z=expr("x/2", num_8))

# ---- group: rawBillet_displayCurves
debrep_2 = DeconstructBrep(Brep=box_2)  # -> Faces, Edges, Vertices
crv = Curve(debrep_2.Edges)
dashsize = Panel("80")
dash = DashPattern(Curve=crv, Pattern=dashsize)  # -> Dashes, Gaps
crv_2 = Curve(dash.Dashes)

# ---- group: rawBillet_edges
# Dimension Display - Text
crv_3 = Curve(debrep_2.Edges)

# ---- group: dimension_isolateCriticalEdges
item_2 = ListItem(List=crv_3, Index=1, Wrap=True)
item_3 = ListItem(List=crv_3, Index=10, Wrap=True)
item_4 = ListItem(List=crv_3, Index=0, Wrap=True)
merge = Merge(Data1=item_4, Data2=item_2, Data3=item_3)

# ---- group: dimension_calcVectors
xy = XYPlane(Origin=Point(0, 0, 0))
eval_4 = EvaluateLength(Curve=[item_4, item_2], Length=0.5, Normalized=True)  # -> Point, Tangent, Parameter
vec2pt = Vector2Pt(PointA=xy, PointB=eval_4.Point, Unitize=False)  # -> Vector, Length
devec = DeconstructVector(Vector=vec2pt.Vector)  # -> XComponent, YComponent, ZComponent
vec = VectorXYZ(XComponent=devec.XComponent, YComponent=devec.YComponent, ZComponent=0)  # -> Vector, Length
unit = UnitVector(Vector=vec.Vector)

# ---- group: dimension_offsetVector
vec_2 = Vector(unit)

# ---- group: dimension_criticalEdges
crv_4 = Curve(merge)

# ---- group: trimmedBillet_layerCurves
crv_5 = Curve(iso.UIsocurve)

# ---- group: trimmedBillet_edgeCurves
crv_6 = Curve(debrep.Edges)

# ---- group: dimension_calcDimLines
dimensionline_offset = Panel("150")
multiplication_8 = Multiplication(A=vec_2, B=dimensionline_offset)
move = Move(Geometry=crv_4, Motion=multiplication_8)  # -> Geometry, Transform

# ---- group: dimension_calcExtLines
end = EndPoints(Curve=crv_4)  # -> Start, End
extensionline_offseta = Panel("50")
extensionline_offsetb = Panel("50")
merge_2 = Merge(Data1=graft(end.Start), Data2=graft(end.End))
flip_2 = FlipMatrix(Data=merge_2)
multiplication_9 = Multiplication(A=vec_2, B=extensionline_offseta)
addition_3 = Addition(A=extensionline_offsetb, B=dimensionline_offset)
move_2 = Move(Geometry=flip_2, Motion=multiplication_9)  # -> Geometry, Transform
multiplication_10 = Multiplication(A=vec_2, B=addition_3)
move_3 = Move(Geometry=flip_2, Motion=multiplication_10)  # -> Geometry, Transform
ln = Line(StartPoint=move_2.Geometry, EndPoint=move_3.Geometry)

# ---- group: volume_transverseLengthRequired (mm)
num_49 = Number(multiplication_5)

# ---- group: volume_longitudinalLengthRequired (mm)
num_50 = Number(multiplication_7)

# ---- group: volume_stockCount
addition_4 = Addition(A=num_50, B=num_49)
c_units_8 = ConvertUnits(Data=int_7, Source=9, Target=2)
division_7 = Division(A=addition_4, B=c_units_8)
round_4 = Round(Number=division_7)  # -> Nearest, Floor, Ceiling

# ---- group: volume_BFperStock
bf_calculator = Expression(T=num_45, W=num_47, L=int_7, Expression="T*W*L/12")

# ---- group: volume_stockRequred
int_13 = Integer(round_4.Ceiling)

# ---- group: volume_BFStockRequired
multiplication_11 = Multiplication(A=int_13, B=bf_calculator)
num_51 = Number(multiplication_11)

# ---- group: volume_fingerjointWaste
addition_5 = Addition(A=100, B=int_8)
multiplication_12 = Multiplication(A=addition_5, B=0.01)
multiplication_13 = Multiplication(A=num_51, B=multiplication_12)

# ---- group: volume_overageCalc
addition_6 = Addition(A=100, B=int_5)
multiplication_14 = Multiplication(A=addition_6, B=0.01)
multiplication_15 = Multiplication(A=multiplication_13, B=multiplication_14)

# ---- group: dimension_dimensionLine
crv_7 = Curve(move.Geometry)

crv_8 = Curve(crv_7)

# ---- group: dimension_textLocation
eval_5 = EvaluateLength(Curve=crv_8, Length=0.5, Normalized=True)  # -> Point, Tangent, Parameter
eval_6 = EvaluateLength(Curve=crv_4, Length=0.5, Normalized=True)  # -> Point, Tangent, Parameter
end_2 = EndPoints(Curve=crv_8)  # -> Start, End
vec2pt_2 = Vector2Pt(PointA=end_2.Start, PointB=end_2.End, Unitize=False)  # -> Vector, Length
vec2pt_3 = Vector2Pt(PointA=eval_5.Point, PointB=eval_6.Point, Unitize=False)  # -> Vector, Length
pl = ConstructPlane(Origin=eval_5.Point, XAxis=vec2pt_2.Vector, YAxis=vec2pt_3.Vector)
move_4 = Move(Geometry=pl, Motion=multiplication_9)  # -> Geometry, Transform

# ---- group: dimensions_textMetric
len = Length(Curve=crv_8)
num_52 = Number(len)
eval_7 = Evaluate(F="Format(\"{0:0.00}\", x)", x=num_52)
concat_2 = Concatenate(FragmentA=eval_7, FragmentB=" mm")
flip_3 = FlipMatrix(Data=simplify(flatten(concat_2)))

# ---- group: dimension_combineText
carriage_return = Panel("")
join = TextJoin(Text=[flip_3, flip], Join=carriage_return)
flip_4 = FlipMatrix(Data=join)

# ---- group: dimension_location
pln = Plane(move_4.Geometry)

# ---- group: dimension_text
txt = Text(flip_4)

# ---- group: dimension_extensionLines
crv_9 = Curve(ln)

# ---- group: volume_BF>m3
bf_to_m3_conversion = Panel("0.0023597372")
multiplication_16 = Multiplication(A=multiplication_15, B=bf_to_m3_conversion)

# ---- group: volume_m3Required
num_53 = Number(multiplication_16)

num_54 = Number(num_53)

# ---- group: pricing_Calcs
multiplication_17 = Multiplication(A=num_54, B=num_17)
multiplication_18 = Multiplication(A=num_54, B=num_18)
subtraction_3 = Subtraction(A=multiplication_17, B=multiplication_18)

# ---- group: pricing_marketRate ($)
num_55 = Number(multiplication_17)

# ---- group: pricing_productionCost ($)
num_56 = Number(multiplication_18)

# ---- group: pricing_profit ($)
num_57 = Number(multiplication_17)

# ---- group: volume_BFRequired
num_58 = Number(multiplication_15)

# ---- group: trimmedBillet_geo
geo = Geometry(box)

# ---- group: lamella_error
bool_6 = Boolean(bool_5)

# ---- group: pricing_productionCost ($)
num_59 = Number(num_56)

# ---- group: pricing_marketRate ($)
num_60 = Number(num_55)

# ---- group: errorDispatch
dispatch = Dispatch(List=geo, DispatchPattern=bool_6)  # -> ListA, ListB

# ---- group: pricing_profit ($)
num_61 = Number(num_57)

# ---- group: efficiency_value
num_62 = Number(num_48)

# ---- group: volume_m3Required
num_63 = Number(num_53)

# ---- group: volume_BFRequired
num_64 = Number(num_58)

# ---- group: efficiency_format
expression_3 = Expression(x=num_62, Expression="Round(x,2) & \"%\"")
stock_profile_efficiency = Panel(expression_3)

# ---- group: pricing_format
panel = Panel("Format(\"{0:0.00}\", x)")
eval_8 = Evaluate(F=panel, x=num_59)
eval_9 = Evaluate(F=panel, x=num_61)
eval_10 = Evaluate(F=panel, x=num_60)
eval_11 = Evaluate(F="\"$\" & x", x=eval_8)
eval_12 = Evaluate(F="\"$\" & x", x=eval_9)
eval_13 = Evaluate(F="\"$\" & x", x=eval_10)

# ---- group: lamella_error
bool_7 = Boolean(bool_5)

# ---- group: displayGeo_error
geo_2 = Geometry(dispatch.ListA)

# ---- group: displayGeo_darkWood
geo_3 = Geometry([crv_6, crv_5])

# ---- group: displayGeo_lightWood
geo_4 = Geometry(dispatch.ListB)

# ---- group: displayGeo_black
geo_5 = Geometry([crv_9, crv_7])

# ---- group: volume_formatM3
eval_14 = Evaluate(F="Format(\"{0:0.000}\", x)", x=num_63)
required_m_3 = Panel(eval_14)
eval_15 = Evaluate(F="x & \" m³\"", x=eval_14)

# ---- group: dimension_location
pln_2 = Plane(pln)

# ---- group: dimension_text
txt_2 = Text(txt)

# ---- group: displayGeo_grey
geo_6 = Geometry(crv_2)

# ---- group: lamella_thicknessWarning
panel_2 = Panel("Required lamella thickness is greater than stock material thickness")
dispatch_2 = Dispatch(List=panel_2, DispatchPattern=bool_7)  # -> ListA, ListB

# ---- group: ignore these
swatch = ColourSwatch(SwatchColor=RGB(255, 0, 0))
swatch_2 = ColourSwatch(SwatchColor=RGB(0, 0, 0))
swatch_3 = ColourSwatch(SwatchColor=RGB(138, 120, 29))
swatch_4 = ColourSwatch(SwatchColor=RGB(0, 0, 0))
swatch_5 = ColourSwatch(SwatchColor=RGB(219, 190, 46))
swatch_6 = ColourSwatch(SwatchColor=RGB(76, 76, 76))

# ----
# ShapeDiver 3D Output
tag_text_size = Panel("60")
gltf2material = GlTF20Material(
    BaseColorFactor=swatch,
    MetallicFactor=0,
    RoughnessFactor=1,
    EmissiveFactor=RGB(0, 0, 0),
    AlphaMode="OPAQUE",
    AlphaCutoff=0.5,
    DoubleSided=True)
gltf2material_2 = GlTF20Material(
    BaseColorFactor=swatch_4,
    MetallicFactor=0,
    RoughnessFactor=1,
    EmissiveFactor=RGB(0, 0, 0),
    AlphaMode="OPAQUE",
    AlphaCutoff=0.5,
    DoubleSided=True)
gltf2material_3 = GlTF20Material(
    BaseColorFactor=swatch_3,
    MetallicFactor=0,
    RoughnessFactor=1,
    EmissiveFactor=RGB(0, 0, 0),
    AlphaMode="OPAQUE",
    AlphaCutoff=0.5,
    DoubleSided=True)
gltf2material_4 = GlTF20Material(
    BaseColorFactor=swatch_5,
    MetallicFactor=0,
    RoughnessFactor=1,
    EmissiveFactor=RGB(0, 0, 0),
    AlphaMode="OPAQUE",
    AlphaCutoff=0.5,
    DoubleSided=True)
gltf2material_5 = GlTF20Material(
    BaseColorFactor=swatch_6,
    MetallicFactor=0,
    RoughnessFactor=1,
    EmissiveFactor=RGB(0, 0, 0),
    AlphaMode="OPAQUE",
    AlphaCutoff=0.5,
    DoubleSided=True)
clt_display = GlTF20Display(Geometry=geo_2, Material=gltf2material)
clt_display_2 = GlTF20Display(Geometry=geo_4, Material=gltf2material_4)
dim_display = GlTF20Display(Geometry=geo_6, Material=gltf2material_5)
clt_display_3 = GlTF20Display(Geometry=geo_3, Material=gltf2material_3)
dim_display_2 = GlTF20Display(Geometry=geo_5, Material=gltf2material_2)

# ---- group: lamella_thickness
num_65 = Number(num_24)

# ---- group: volume_formatBF
round_5 = Round(Number=num_64)  # -> Nearest, Floor, Ceiling
eval_16 = Evaluate(F="x & \" bf\"", x=round_5.Ceiling)
required_bf = Panel(round_5.Ceiling)

# ---- group: lamella_format
expression_4 = Expression(x=num_65, Expression="x & \"mm\"")

# ---- group: dimension_textDisplay
tag = TextTag3D(Location=pln_2, Text=txt_2, Size=tag_text_size, Colour=swatch_2, Justification=5)

# ----
# ShapeDiver Data Output
system_message = DirectDataOutput(Data=dispatch_2.ListA)
market_cost = DirectDataOutput(Data=eval_13)
production_cost = DirectDataOutput(Data=eval_11)
profit = DirectDataOutput(Data=eval_12)
profile_efficiency = DirectDataOutput(Data=expression_3)
layer_thickness = DirectDataOutput(Data=expression_4)
fibre_order_bf = DirectDataOutput(Data=eval_16)
fibre_order_m3 = DirectDataOutput(Data=eval_15)
