# Grasshopper definition ShapeDiver_Dimensions-C#.gh (Grasshopper 1.0.8)
# plug-ins: RhinoCodePluginGH, ShapeDiverForGrasshopper

# ---- group: Dimension
xy = XYPlane(Origin=Point(0, 0, 0))
debrep = DeconstructBrep()  # -> Faces, Edges, Vertices
xz = XZPlane(Origin=Point(0, 0, 0))
prot = RotatePlane(Plane=xy, Angle=-1.570796327)
merge = Merge(Data1=xy, Data2=prot, Data3=xz)
item = ListItem(List=debrep.Edges, Index=1, Wrap=True)
item_2 = ListItem(List=debrep.Edges, Index=0, Wrap=True)
item_3 = ListItem(List=debrep.Edges, Index=10, Wrap=True)
line = Line([item_2, item, item_3])
bool = Boolean(True)
bool_2 = Boolean(True)
linear_dimension_new = CSharpScript(
    alternativeBasePln=merge,
    baseLine=line,
    dimOffset="150",
    markSign=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,
    markSize="30",
    markSpace=bool_2,
    txtFormat="0.00",
    txtSize="60",
    txtGap=bool)  # -> out, dimGeo, txtRec, txt, txtEntity, txtCrvs; inputs alternativeBasePln: Plane, baseLine: Line, dimOffset: Double, markSign: list of GeometryBase, markSize: Double, markSpace: Boolean, alternativeTxt: String, txtFormat: String, txtFont: String, txtSize: Double, txtPositionX: Double, txtPositionY: Double, flipTxt: Boolean, txtGap: Boolean, getTxtCrvs: Boolean
# ---------- linear_dimension_new: C# ----------
// Grasshopper Script Instance
#region Usings
using System;
using System.Linq;
using System.Collections;
using System.Collections.Generic;
using System.Drawing;

using Rhino;
using Rhino.Geometry;

using Grasshopper;
using Grasshopper.Kernel;
using Grasshopper.Kernel.Data;
using Grasshopper.Kernel.Types;

using Rhino.Geometry.Intersect;
using System.Linq;
#endregion

public class Script_Instance : GH_ScriptInstance
{
    #region Notes
    /* 
      Members:
        RhinoDoc RhinoDocument
        GH_Document GrasshopperDocument
        IGH_Component Component
        int Iteration

      Methods (Virtual & overridable):
        Print(string text)
        Print(string format, params object[] args)
        Reflect(object obj)
        Reflect(object obj, string method_name)
    */
    #endregion

    private void RunScript(
	Plane alternativeBasePln,
	Line baseLine,
	double dimOffset,
	List<GeometryBase> markSign,
	double markSize,
	bool markSpace,
	string alternativeTxt,
	string txtFormat,
	string txtFont,
	double txtSize,
	double txtPositionX,
	double txtPositionY,
	bool flipTxt,
	bool txtGap,
	bool getTxtCrvs,
	ref object dimGeo,
	ref object txtRec,
	ref object txt,
	ref object txtEntity,
	ref object txtCrvs)
    {
    List<GeometryBase> dimensionGeometry = new List<GeometryBase>();
    if (baseLine.Length == 0)
    {
      dimGeo = dimensionGeometry;
      return;
    }

    double txtPost = (txtPositionX > 0.0) ? txtPositionX : 0.5;
    Plane basePln = alternativeBasePln.IsValid ? alternativeBasePln : new Plane(Point3d.Origin, baseLine.UnitTangent, Vector3d.CrossProduct(baseLine.UnitTangent, Vector3d.ZAxis * -1));
    txtFormat = string.IsNullOrEmpty(txtFormat) ? "0" : txtFormat;

    //base vectors to work with
    Vector3d crossVector = Vector3d.CrossProduct(baseLine.UnitTangent, basePln.Normal);
    Vector3d offsetVector = crossVector * dimOffset;
    Vector3d markSizeVector = baseLine.UnitTangent * markSize;
    Vector3d crossMarkSizeVector = crossVector * markSize * 0.5;

    //base dimension line
    Line dimensionLine = new Line (baseLine.From + offsetVector, baseLine.To + offsetVector);

    //create text entity for dimension text
    Rhino.Geometry.TextEntity myText = new Rhino.Geometry.TextEntity();
    myText.DrawForward = false;
    double potentialNum;
    myText.PlainText = string.IsNullOrEmpty(alternativeTxt) ? baseLine.Length.ToString(txtFormat) : double.TryParse(alternativeTxt, out potentialNum) ? potentialNum.ToString(txtFormat) : alternativeTxt;
    myText.TextHeight = txtSize;
    myText.Font = new Rhino.DocObjects.Font(txtFont);
    myText.Justification = TextJustification.MiddleCenter;

    //getting text rectangle size
    BoundingBox myTextBox = myText.GetBoundingBox(true);
    double txtRecWidth = myTextBox.Max.X - myTextBox.Min.X + 0.1 * txtSize;
    double txtRecHeight = myTextBox.Max.Y - myTextBox.Min.Y;

    //reposition base plane based on dimension line position and orientation
    basePln.Origin = baseLine.PointAt(txtPost) + offsetVector - (crossVector * txtRecHeight * txtPositionY * 0.6);
    if (flipTxt) basePln.Rotate(Math.PI, basePln.Normal);

    //compute text rectangle
    Rectangle3d baseRec = new Rectangle3d(basePln, new Interval(txtRecWidth / -2, txtRecWidth / 2), new Interval(txtRecHeight / -2, txtRecHeight / 2));
    myText.Plane = basePln;

    //creating dimension gap and extending base dimension line
    int _markSpace = Convert.ToInt32(markSpace);
    bool flipMarkStart = false;
    bool flipMarkEnd = false;
    LineCurve testLine = new LineCurve(dimensionLine.From + (markSizeVector * _markSpace), dimensionLine.To - (markSizeVector * _markSpace));
    CurveIntersections intersectGap = txtGap ? Intersection.CurveCurve(new PolylineCurve(baseRec.ToPolyline()), testLine, 0.01, 0.01) : null;
    if (intersectGap != null && intersectGap.Count == 2)
    {
      double[] intersectParams = new double[]{intersectGap[0].ParameterB,intersectGap[1].ParameterB};
      Point3d[] intersectPnts = new Point3d[]{intersectGap[0].PointB,intersectGap[1].PointB};
      Array.Sort(intersectParams, intersectPnts);
      LineCurve firstDimLine = new LineCurve(dimensionLine.From + markSizeVector * _markSpace, intersectPnts[0]);
      LineCurve lastDimLine = new LineCurve(intersectPnts[1], dimensionLine.To - markSizeVector * _markSpace);
      dimensionGeometry.Add(firstDimLine);
      dimensionGeometry.Add(lastDimLine);
    }
    else if (intersectGap != null && intersectGap.Count == 1)
    {
      Point3d intersectPnt = intersectGap[0].PointB;
      Point3d[] endPnts = new Point3d[]{dimensionLine.From,dimensionLine.To};
      double[] distances = new double[]{txtPost, 1 - txtPost};
      Array.Sort(distances, endPnts);
      int multiplier = endPnts[1].DistanceTo(dimensionLine.From) == 0 ? 1 : -1;
      if (multiplier == -1) flipMarkStart = true;
      else flipMarkEnd = true;
      dimensionGeometry.Add(new LineCurve(endPnts[1] + markSizeVector * _markSpace * multiplier, intersectPnt));
      dimensionGeometry.Add(new LineCurve(endPnts[0] + markSizeVector * multiplier, endPnts[0] + markSizeVector * multiplier * _markSpace * 2));
    }
    else
    {
      if (txtPositionY > -1 && txtPositionY < 1 &&
        baseRec.Contains(testLine.PointAtStart) == PointContainment.Inside &&
        baseRec.Contains(testLine.PointAtEnd) == PointContainment.Inside)
      {
        Transform moveFromLine = Transform.Translation(crossVector * txtRecHeight * -0.6);
        myText.Transform(moveFromLine);
        baseRec.Transform(moveFromLine);
      }

      if (baseLine.Length < (markSize * _markSpace * 3))
      {
        flipMarkStart = true;
        flipMarkEnd = true;
        dimensionGeometry.Add(new LineCurve(dimensionLine.From - markSizeVector, dimensionLine.From - markSizeVector * _markSpace * 2));
        dimensionGeometry.Add(new LineCurve(dimensionLine.To + markSizeVector, (dimensionLine.To + markSizeVector * _markSpace * 2)));
      }
      else
        dimensionGeometry.Add(testLine);

    }

    //end marks
    LineCurve startMark = new LineCurve(dimensionLine.From - crossMarkSizeVector, dimensionLine.From + crossMarkSizeVector);
    dimensionGeometry.Add(startMark);
    LineCurve endMark = new LineCurve(dimensionLine.To - crossMarkSizeVector, dimensionLine.To + crossMarkSizeVector);
    dimensionGeometry.Add(endMark);
    Plane startMarkPlane = new Plane(dimensionLine.From, crossVector, baseLine.UnitTangent * (flipMarkStart ? -1 : 1));
    Plane endMarkPlane = new Plane(dimensionLine.To, crossVector * -1, baseLine.UnitTangent * (flipMarkEnd ? 1 : -1));
    Transform scaleXForm = Transform.Scale(Point3d.Origin, markSize);
    List<GeometryBase> startSign = (from g in markSign select g.DuplicateShallow()).ToList();
    foreach (GeometryBase g in startSign) g.Transform(Transform.PlaneToPlane(Plane.WorldXY, startMarkPlane) * scaleXForm);
    List<GeometryBase> endSign = (from g in markSign select g.DuplicateShallow()).ToList();
    foreach (GeometryBase g in endSign) g.Transform(Transform.PlaneToPlane(Plane.WorldXY, endMarkPlane) * scaleXForm);

    dimensionGeometry.AddRange(startSign);
    dimensionGeometry.AddRange(endSign);

    dimGeo = dimensionGeometry;
    txtRec = baseRec;
    txt = myText.PlainText;
    txtEntity = myText;
    if (getTxtCrvs) txtCrvs = myText.Explode();
    }
}
# ---------- end linear_dimension_new ----------
_3d_text = BooleanToggle(False)
C = Color(RGB(255, 255, 255))
pln = Plane(linear_dimension_new.txtRec)
gate = StreamGate(Stream=pln, Gate=_3d_text)  # -> Target0, Target1
gltf2material = GlTF20Material(
    BaseColorFactor=C,
    MetallicFactor=0,
    RoughnessFactor=1,
    EmissiveFactor=RGB(0, 0, 0),
    AlphaMode="OPAQUE",
    AlphaCutoff=0.5,
    DoubleSided=True)
gltfdisplay = GlTF20Display(Geometry=linear_dimension_new.dimGeo, Material=gltf2material)
_2dtagdimensions = TextTag(Location=gate.Target0, Text=linear_dimension_new.txt, Colour=C)
tag = TextTag3D(Location=gate.Target1, Text=linear_dimension_new.txt, Size="30", Colour=C, Justification=5)
